% Simulink data dictionary asbCubeSatModelData.sldd

CubeSatTimeStep = 1
gains = struct(Kp=5.5e-5, Ki=0, Kd=0.017)
vehicle = struct(mass=1, inertia=[1 0 0; 0 1 0; 0 0 1])

StatesOutBus = Simulink.Bus()
  utc_JD: double
  X_ecef: double[3]
  V_ecef: double[3]
  X_eci: double[3]
  V_eci: double[3]
  q_ecef2b: double[4]
  q_eci2b: double[4]
  Euler: double[3]
  LatLonAlt: double[3]
  SunAngle: double
  SunInView: boolean

ACSOutBus = Simulink.Bus()
  AttitudeError: AttitudeErrorBus
  TorqueCmds: double[3]
  cmd_q_b2tgt: double[4]
  NavMode: double

FCSOutBus = Simulink.Bus()
  ACSOut: ACSOutBus

AttitudeErrorBus = Simulink.Bus()
  Roll: double
  Pitch: double
  Yaw: double

EnvBus = Simulink.Bus()
  envAccel_ecef: double[3]
  envForces_body: double[3]
  envTorques_body: double[3]
  x_sun_eci: double[3]
  earthAngRate: double[3]

initCond = struct(
  simStartDate=struct(JD=2458488, dateVector=[2019 1 4 12 0 0]),
  CoordEpoch=struct(JD=2451545, dateVector=[2000 1 1 12 0 0]),
  OrbitalElements=struct(
    semiMajorAxis=6786233.13,
    eccentricity=0.0010537,
    inclination=97,
    RAAN=95.2562,
    argumentOfPerigee=93.4872,
    trueAnomoly=302.9234,
    trueLongitude=0,
    argumentOfLatititude=0,
    longitudeOfPerigee=0),
  r_eci=[-11477.22 5480313 3995772],
  v_eci=[1165.93 -4469.139 6121.392],
  r_ecef=[-5331902 1267351 3995597],
  v_ecef=[4707.584 463.076 6123.622],
  lla=[36.26665 166.6294 411648.5],
  v_ned=[7583.225 -1539.15 -16.01738],
  uvw=[7166.711 -2761.31 942.3141],
  euler=[33.9 -5.91 9.88],
  pqr=[0 0 0])